vi "Main.gviweb"   [LabVIEW NXG 2.1.0]
panel controls:
  "Run Sequence": bool
  "System": T2 = "INTEL-NUC-1"
  "Simulate Failure": enum{"None", "Keyboard", "Video", "Power"} = "None"
  "Amplitude": f64 = 10
  "Automatically pick a system": bool = TRUE
  "Test": T3 = "Computer Motherboard Tests.seq"
panel indicators:
  "Data Grid": T1[]
  "Parameters": i32
types:
  T1 = cluster{"System": string, "Test Program": string, "UUT": string, "Status": string, "Last Updated": string, "Queue": f64}
  T2 = enum{"PXI-ATDEMO-1", "PXI-ATDEMO-2", "PXIe-8840Quad-1", "PXIe-8840Quad-2", "PXIe-8840Quad-3", "INTEL-NUC-1", "INTEL-NUC-2", "SCS-8135"}
  T3 = enum{"Computer Motherboard Tests.seq", "Power Test.seq"}
uses:
  NI::Skyline::Configuration::Open Configuration.gvi
  WebApp::Pick System.gviweb
  WebApp::Get Minion ID.gviweb
diagram:
  w1 = FALSE  # Development
  case (w1) {
    frame False, Default {
      # Set Development boolean to False in order to
      # clear server, username, and password
      # before building and deploying the application
      # to your web server or SystemLink.
      w5 = ""  # Server
      w6 = ""  # Username
      w7 = ""  # Password
      w2 = w7
      w3 = w6
      w4 = w5
    }
    frame True {
      # Set Development boolean to True and
      # change the server, username, and password
      # to match your web server.  Also, ensure that CORS
      # is enabled on your web server before trying to
      # interactively run your application from within NXG.
      w8 = "http://server"  # Server
      w9 = "admin"  # Username
      w10 = "password"  # Password
      w2 = w10
      w3 = w9
      w4 = w8
    }
  }
  call "Open Configuration.gvi"(server url=w4, username=w3, password=w2) -> (configuration=w11)
  while {
    case ($"Run Sequence") {
      frame True {
        case ($Test) {
          frame Default {
            w12 = "[]"
          }
          frame "Computer Motherboard Tests.seq" {
            case ($"Simulate Failure") {
              frame "None", Default {
                w12 = "[]"
              }
              frame "Keyboard" {
                w12 = "[\"Keyboard=5\"]"
              }
              frame "Video" {
                w12 = "[\"Video=12\"]"
              }
              frame "Power" {
                w12 = "[\"PowerFail=True\"]"
              }
            }
          }
          frame "Power Test.seq" {
            Number To Fractional String(number=$Amplitude, precision (6)=2) -> (F-format string=w13)
            Concatenate Strings("[\"Amplitude=", w13, "\"]") -> w12
          }
        }
        Format Into String($Test) -> w14
        # Sequence must be some where in the TestStand path like C:\Users\Public\Documents\TestSequences
        case ($"Automatically pick a system") {
          frame True {
            call "Pick System.gviweb"(configuration in=w11, sequence=w14) -> (configuration out=w16, minion id=w15)
          }
          frame False {
            Format Into String($System) -> w17
            call "Get Minion ID.gviweb"(configuration in=w11, hostname=w17) -> (configuration out=w16, id=w15)
          }
        }
        call "Run Sequence.gviweb"(configuration=w16, minion ID=w15, sequence=w14, args=w12, timeout=600)
      }
      frame False {
        Wait(time to wait=200)
      }
    }
    $Parameters <- $Test
    stop if FALSE
  }
  while {
    Wait(time to wait=1000)
    call "Get Tester Status.gviweb"(Configuration=w11) -> (Testers=w18)
    $"Data Grid" <- w18
    stop if FALSE
  }
